# Grasshopper definition ground_temp_and_earth_berming.gh (Grasshopper 1.0.7)
# plug-ins: LadybugGrasshopper

berm_n = Slider(0, range=0..1)
berm_e = Slider(0, range=0..1)
berm_s = Slider(0, range=0..1)
depth = Slider(1, range=-3..1)
berm_w = Slider(0, range=0..1)
galapagos = Galapagos(fitness=addition, gene=[berm_n, berm_e, berm_s, berm_w])

# ---- group: EPW
# 0. EPW AND APPROXIMATED GROUND TEMPERATURES
panel = Panel("https://climate.onebuilding.org/WMO_Region_6_Europe/DEU_Germany/SL_Saarland/DEU_SL_Saarbrucken.AP.107080_TMYx.zip")
downloadepw = LBDownloadWeather(weather_URL=panel)  # -> epw_file, stat_file, ddy_file; plug-in component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
importepw = LBImportEPW(epw_file=downloadepw.epw_file)  # -> location, dry_bulb_temperature, dew_point_temperature, relative_humidity, wind_speed, wind_direction, direct_normal_rad, diffuse_horizontal_rad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; plug-in component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

# ----
# 1. EARTH BERMING
berm_n_2 = Brep(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)
berm_e_2 = Brep(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)
berm_s_2 = Brep(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)
berm_w_2 = Brep(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)
stream_filter = StreamFilter(Gate=berm_n, Stream1=berm_n_2)
stream_filter_2 = StreamFilter(Gate=berm_e, Stream1=berm_e_2)
stream_filter_3 = StreamFilter(Gate=berm_s, Stream1=berm_s_2)
stream_filter_4 = StreamFilter(Gate=berm_w, Stream1=berm_w_2)
brep = Brep([stream_filter, stream_filter_2, stream_filter_3, stream_filter_4])

unit_z = UnitZ(Factor=depth)
windows = Brep([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])
# 2. BASEMENT
house = Brep(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)
ground = Brep(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)
move = Move(Geometry=house, Motion=unit_z)  # -> Geometry, Transform
move_2 = Move(Geometry=windows, Motion=unit_z)  # -> Geometry, Transform
split_brep = SplitBrep(Brep=move.Geometry, Cutter=ground)
smaller_than = SmallerThan(FirstNumber=depth, SecondNumber=0)  # -> SmallerThan, OrEqualTo
brep_join = BrepJoin(Breps=split_brep)  # -> Breps, Closed
list_item = ListItem(List=split_brep, Index=1, Wrap=True)
stream_filter_5 = StreamFilter(Gate=smaller_than.SmallerThan, Stream0=move.Geometry, Stream1=brep_join.Breps)

# ---- group: GROUND TEMPERATURE APPROXIMATION
ground_type_thermal_diffusivity = ValueList({"Soil": 0.02, "Sandstone": 0.05, "Bedrock": 0.1}, selected="Bedrock")
depth_2 = Slider(7, range=0..20)
approximate_ground_temperature = ApproximateGroundTemperature(list=importepw.ground_temperature, depth=depth_2, a=ground_type_thermal_diffusivity)  # -> nearest, data_2

# ---- group: DISPLAY GROUND TEMPERATURE FROM EPW
panel_2 = Panel("""type: 0.5 m (EPW)
type: 2 m  (EPW)
type: 4 m  (EPW)""")
applymeta = LBApplyMetadata(data=graft(importepw.ground_temperature), metadata=graft(panel_2))  # -> flatten(data); plug-in component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

# ---- group: GROUND TEMPERATURE CHART
point = Point(Point(0, 43.1405267, 0))
monthlychart = LBMonthlyChart(data=[applymeta, approximate_ground_temperature.data_2], base_pt=point, global_title="Ground Temperature")  # -> out, data_mesh, data_lines, col_lines, legend, borders, labels, y_title, title, vis_set; plug-in component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

# ----
compass = LBCompass()  # -> compass; plug-in component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

# ---- group: SIMULATION CONTROL
hourly = BooleanToggle(False)
timestep = ValueList({"Fast": 1, "Default": 6, "Accurate": 12}, selected="Fast")
terrain = ValueList({"Ocean", "Country", "Suburbs", "Urban", "City"}, selected="Suburbs")
ground_depth = ValueList({"0.5 m": 0, "2 m": 1, "4 m": 2}, selected="0.5 m")
write = LBFalseStartToggle(False)
run = LBFalseStartToggle(False)

# ---- group: CUSTOM GROUND TEMPERATURES
list_item_2 = ListItem(List=importepw.ground_temperature, Index=ground_depth, Wrap=True)
xdata = LBDeconstructData(data=list_item_2)  # -> header, flatten(values); plug-in component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
round = Round(Number=xdata.values)  # -> Nearest, Floor, Ceiling
text_join = TextJoin(Text=round.Nearest, Join=",")
format = Format(Format="Site:GroundTemperature:BuildingSurface,{0};", Culture=127, Data0=text_join)  # -> flatten(Text)
ground_temperatures_from_epw = Panel(format)

# ----
house_2 = Brep(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)
roomsolid = HBRoomFromSolid(geo=flatten(house_2), conditioned=True)  # -> out, rooms; plug-in component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
gate_or = GateOr(A=berm_n, B=berm_e, C=berm_s, D=berm_w)
window_ratio = Slider(0.2, range=0..1)

# ---- group: DEFINE GROUND
guidesurface = HBPropertiesByGuideSurface(rooms=roomsolid.rooms, guide=brep, bc="Ground")  # -> rooms; plug-in component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

# ----
stream_filter_6 = StreamFilter(Gate=gate_or, Stream0=roomsolid.rooms, Stream1=guidesurface)
aperturesbyratio = HBAperturesByRatio(hb_objs=flatten(stream_filter_6), ratio=window_ratio)  # -> out, hb_objs; plug-in component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

# ---- group: ENERGY MODEL AND DISPLAY
model = HBModel(rooms=flatten(aperturesbyratio.hb_objs))  # -> out, model; plug-in component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
hb_face_attributes = HBFaceAttributes({"Display Name": "display_name", "Simulation Name (Identifier)": "identifier", "Boundary Condition": "boundary_condition", "Has Parent": "has_parent", "Parent": "parent", "Azimuth": "azimuth", "Altitude": "altitude", "Area": "area", "Perimeter": "perimeter", "Face Type": "type", "Aperture Is Operable": "is_operable", "Door Is Glass": "is_glass"}, selected="Boundary Condition")
vizbytype = HBVisualizeByType(hb_objs=model.model)  # -> walls, interior_walls, roofs, ceilings, exterior_floors, interior_floors, air_walls, apertures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; plug-in component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
lablefaces = HBLabelFaces(hb_objs=flatten(model.model), attribute=hb_face_attributes)  # -> label_text, base_pts, labels, wire_frame; plug-in component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

# ---- group: RUN SIMULATION
boolean_toggle = BooleanToggle(True)
panel_3 = Panel("""Monthly
Hourly""")
list_item_3 = ListItem(List=panel_3, Index=hourly, Wrap=True)
simoutput = HBSimulationOutput(
    zone_energy_use=boolean_toggle,
    system_energy_use=boolean_toggle,
    gains_and_losses=boolean_toggle,
    comfort_metrics=boolean_toggle,
    surface_temperature=boolean_toggle,
    surface_energy_flow=boolean_toggle,
    report_frequency=list_item_3)  # -> out, sim_output; plug-in component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
simpar = HBSimulationParameter(output=simoutput.sim_output, timestep=timestep, terrain=terrain)  # -> sim_par; plug-in component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
modeltoosm = HBModelToOSM(
    model=model.model,
    epw_file=downloadepw.epw_file,
    sim_par=simpar,
    add_str=ground_temperatures_from_epw,
    write=write,
    run=run)  # -> out, jsons, osw, osm, idf, sql, zsz, rdd, html; plug-in component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

# ---- group: SETUP ENERGY MODEL
roomsolid_2 = HBRoomFromSolid(geo=flatten(stream_filter_5), conditioned=True)  # -> out, rooms; plug-in component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
aperture = HBAperture(geo=move_2.Geometry)  # -> out, apertures; plug-in component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
addsubface = HBAddSubface(hb_obj=flatten(roomsolid_2.rooms), sub_faces=flatten(aperture.apertures), project_dist=0)  # -> out, hb_obj, unmatched; plug-in component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

# ---- group: SETUP ENERGY MODEL / DEFINE GROUND
guidesurface_2 = HBPropertiesByGuideSurface(rooms=addsubface.hb_obj, guide=list_item, bc="Ground")  # -> rooms; plug-in component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

# ---- group: SETUP ENERGY MODEL (continued)
stream_filter_7 = StreamFilter(Gate=smaller_than.SmallerThan, Stream0=addsubface.hb_obj, Stream1=guidesurface_2)

# ---- group: READ RESULTS
roomenergyresult = HBReadRoomEnergyResult(sql=modeltoosm.sql)  # -> cooling, heating, lighting, electric_equip, gas_equip, process, hot_water, fan_electric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; plug-in component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
faceresult = HBReadFaceResult(sql=modeltoosm.sql)  # -> face_indoor_temp, face_outdoor_temp, face_energy_flow; plug-in component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
loadbalance = HBThermalLoadBalance(
    rooms_model=flatten(model.model),
    cooling=roomenergyresult.cooling,
    heating=roomenergyresult.heating,
    lighting=roomenergyresult.lighting,
    electric_equip=roomenergyresult.electric_equip,
    process=roomenergyresult.process,
    hot_water=roomenergyresult.hot_water,
    people_gain=roomenergyresult.people_gain,
    solar_gain=roomenergyresult.solar_gain,
    infiltration_load=roomenergyresult.infiltration_load,
    mech_vent_load=roomenergyresult.mech_vent_load,
    nat_vent_load=roomenergyresult.nat_vent_load,
    face_energy_flow=faceresult.face_energy_flow)  # -> out, balance, balance_stor, norm_bal, norm_bal_stor; plug-in component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

# ----
normbyflr = HBNormalizeByFloorArea(data=roomenergyresult.cooling, model=model.model)  # -> total_data, room_data; plug-in component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
normbyflr_2 = HBNormalizeByFloorArea(data=roomenergyresult.heating, model=model.model)  # -> total_data, room_data; plug-in component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

# ---- group: READ RESULTS (continued)
xdata_2 = LBDeconstructData(data=normbyflr_2.total_data)  # -> header, flatten(values); plug-in component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
xdata_3 = LBDeconstructData(data=normbyflr.total_data)  # -> header, flatten(values); plug-in component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
mass_addition = MassAddition(Input=xdata_2.values)  # -> Result, PartialResults
mass_addition_2 = MassAddition(Input=xdata_3.values)  # -> Result, PartialResults
total_cooling_load_kwh_m2 = Panel(mass_addition_2.Result)
total_heating_load_kwh_m2 = Panel(mass_addition.Result)

# ---- group: READ RESULTS / TOTAL HEATING AND COOLING LOAD
addition = Addition(A=mass_addition_2.Result, B=mass_addition.Result)

# ----
total_heating_and_cooling_load_kwh_m2 = Panel(addition)

# ---- group: LOAD BALANCE CHART
panel_4 = Panel("Thermal Load Balance, Total Heating Load: {0} kWh/m², Total Cooling Load: {1} kWh/m²")
min_max = Panel("55")
colrange = LBColorRange(index=19)  # -> colors; plug-in component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
negative = Negative(Value=min_max)
format_2 = Format(Format=panel_4, Culture=127, Data0=total_heating_load_kwh_m2, Data1=total_cooling_load_kwh_m2)
legendpar = LBLegendParameters(min=negative, max=min_max, colors=colrange)  # -> leg_par; plug-in component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
point_2 = Point(Point(0, -46.56158054, 0))
monthlychart_2 = LBMonthlyChart(data=loadbalance.norm_bal_stor, base_pt=point_2, stack=True, global_title=format_2, legend_par=legendpar)  # -> out, data_mesh, data_lines, col_lines, legend, borders, labels, y_title, title, vis_set; plug-in component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

# ==== cluster ApproximateGroundTemperature
list = ClusterInput()

# ---- group: EPW ground surface temp monthly
list_item = ListItem(List=list, Index=0, Wrap=True)
xdata = LBDeconstructData(data=list_item)  # -> header, values; plug-in component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

# ---- group: mean annual ground temp
average = Average(Input=xdata.values)

# ---- group: annual range of temperature at ground surface
bounds = Bounds(Numbers=xdata.values)
deconstruct_domain = DeconstructDomain(Domain=bounds)  # -> Start, End
subtraction = Subtraction(A=deconstruct_domain.End, B=deconstruct_domain.Start)
absolute = Absolute(Value=subtraction)

# ---- group: day of year with lowest temperature at ground surface
member_index = MemberIndex(Set=xdata.values, Member=deconstruct_domain.Start)  # -> Index, Count
hoy = LBCalculateHOY(month=member_index.Index)  # -> flatten(hoy), flatten(doy), flatten(date); plug-in component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
panel = Panel([hoy.doy, hoy.date])

# ----
series = Series(Start="1", Step=1, Count="12")
hoy_2 = LBCalculateHOY(month=series)  # -> flatten(hoy), flatten(doy), flatten(date); plug-in component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
depth = ClusterInput()
a = ClusterInput()

# ---- group: GROUND TEMPERATURE - Labs (1979)
expression = Expression(
    depth=depth,
    doy=hoy_2.doy,
    Tm=average,
    As=absolute,
    t0=hoy.doy,
    a=a,
    Expression="Tm-As*e^(-depth*sqrt(π/(365*a)))*cos((2*π/365)*(doy-t0-(depth/2)*sqrt(365/(π*a))))")

# ----
format = Format(Format="type: {0}m (Approximated)", Culture=127, Data0=depth)
constrheader = LBConstructHeader(data_type="Temperature", metadata=format)  # -> header; plug-in component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
round = Round(Number=expression)  # -> Nearest, Floor, Ceiling
data = LBConstructData(header=constrheader, values=expression, interval="monthly")  # -> flatten(data); plug-in component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
nearest = ClusterOutput(round.Nearest)
data_2 = ClusterOutput(data)
